# Grasshopper definition testintersection.ghx (Grasshopper 1.0.7)

rec = Rectangle({Plane=PlaneXY(0.687620324, 2.28815518, 0), Size=Domain2(u=-1.117081028..1.117081028, v=-2.461069139..2.461069139)})
pt = Point(Point(0.9739159733, 2.514760303, 0))
python = GhPythonScript(x=rec, y=pt)  # -> a; inputs y: Point3d
# ---------- python: Python ----------
from ghpythonlib.componentbase import executingcomponent as component
import Grasshopper, GhPython
import System
import Rhino
import rhinoscriptsyntax as rs
from Rhino.Geometry import Point3d,Vector3d

class MyComponent(component):
    
    def RunScript(self, x, y):
        
        """Provides a scripting component.
            Inputs:
                x: The x script variable
                y: The y script variable
            Output:
                a: The a output variable"""
        
        __author__ = "remote"
        __version__ = "2020.05.20"
        
        import rhinoscriptsyntax as rs
        
        rarea = rs.coercecurve(x)
        print rarea.GetType()
        rc,pl = rarea.TryGetPolyline()
        print pl.GetType()
        #Rhino.Geometry.Polyline.
        ad = pl.ToArray()
        print ad
        # return outputs if you have them; here I try it for you:
        return None
# ---------- end python ----------
python_2 = GhPythonScript(x=rec, y=pt)  # -> a; inputs y: Point3d
# ---------- python_2: Python ----------
from ghpythonlib.componentbase import executingcomponent as component
import Grasshopper, GhPython
import System
import Rhino as rh
import rhinoscriptsyntax as rs
import scriptcontext as sc
import Rhino.Geometry
from Rhino.Geometry import Vector3d,Point3d,Line,Polyline
import math

class MyComponent(component):
    
    def RunScript(self, x, y):
        """Provides a scripting component.
            Inputs:
                x: The x script variable
                y: The y script variable
            Output:
                a: The a output variable"""
        
        __author__ = "remote"
        __version__ = "2020.05.19"
        
        import rhinoscriptsyntax as rs
        print x.GetType()
        rarea = rs.coercecurve(x)
        
        #Rhino.Geometry.NurbsCurve.Points
        #Rhino.Geometry.ControlPoint.Location
        print rarea.Points[0].Location
        #print pl
        rc,pl = rarea.TryGetPolyline()
        
        vecDir = Vector3d(0,1,0)
        diag = Vector3d.Subtract(Vector3d(rarea.Points[0].Location),Vector3d(rarea.Points[2].Location))
        length = diag.Length
        #print diag
        #print len
        print "abababababababa"
        vec1 = rs.VectorRotate(vecDir,-60,(0,0,1))
        endl1 = Point3d.Add(y,(vec1*length))
        mLine1 = Line(y,endl1)
        
        vec2 = rs.VectorRotate(vecDir,60,(0,0,1))
        endl2 = Point3d.Add(y,(vec2*length))
        mLine2 = Line(y,endl2)
        #Line.to
        iSect1 = Rhino.Geometry.Intersect.Intersection.CurveCurve(rarea,mLine1.ToNurbsCurve(),0,0)
        iSect2 = Rhino.Geometry.Intersect.Intersection.CurveCurve(rarea,mLine2.ToNurbsCurve(),0,0)
        
        for inte in iSect1:
            point1 = inte.PointA
            
        for inte in iSect2:
            point2 = inte.PointA
            
        print (mLine1.Direction/mLine1.Length)
        
        #print point1
        #print point2
        
        deg = math.degrees(math.atan2(vec1.Y,vec1.X)-math.atan2(vec2.Y,vec2.X))
        #print deg
        
        #Vector3d.Unitize(
        vpointList = []
        for poin in rarea.Points:
            vect = Vector3d.Subtract(Vector3d(poin.Location),Vector3d(y))
            vect.Unitize()
            angle = math.degrees(math.atan2(vect.Y,vect.X)-math.atan2(vec1.Y,vec1.X))
            if angle >= 0 and angle <= 120:
                vpointList.append((vect,poin.Location))
        #print vpointList
        
        vpointList.sort(key = lambda x: math.degrees(math.atan2(x[0].Y,x[0].X)-math.atan2(vec1.Y,vec1.X)),reverse = True)
        
        #print vpointList
        pointList = []
        pointList.append(y)
        pointList.append(point2)
        for vpoint in vpointList:
            pointList.append(vpoint[1])
        pointList.append(point1)
        pointList.append(y)
        
        #print pointList
        
        
        view = sc.doc.Views.ActiveView.ActiveViewport      
        objectList = rh.RhinoDoc.ActiveDoc.Objects.FindByCrossingWindowRegion(view,pointList,True,rh.DocObjects.ObjectType.Curve)
        
        sc.doc = rh.RhinoDoc.ActiveDoc
        layerIndex = sc.doc.Layers.Find("ARS_DINDING",True)
        sc.doc = ghdoc
        
        wallList = [item for item in objectList if item.Attributes.LayerIndex == layerIndex]
                
        mLine2.To = point2
        mLine1.To = point1
        
        #Rhino.Geometry.Curve(
        
        viewArea = Polyline(pointList)
        
        print viewArea.Item
        for i in viewArea.GetSegments():
            print i#.GetType()
            
        #Polyline.GetSegments(
        #for itm in viewArea.
        
        checkedWall = []
        #print wallList.GetType()
        #checkedWall.Size
        #lon = len(checkedWall)
        while len(wallList) > 0:
            curWall = wallList.pop()
            #Rhino.DocObjects.CurveObject.
            iSect = Rhino.Geometry.Intersect.Intersection.CurveCurve(viewArea.ToNurbsCurve(),curWall.Geometry,0,0)
            #print curWall.Id
            #for sect in iSect:
                #print sect.PointA
                #print sect.PointB
            #print len(iSect)
            pointToConsiderate = []
            
            #intersection point
            for sect in iSect:
                pointToConsiderate.append(sect.PointA)
            
            #point in wall inside view area + projection into view area
            #Rhino.Geometry.Curve.Contains(
            isPol,pointInCurve = curWall.Geometry.TryGetPolyline()
            #pointInCurve = pointInCurve[:-1]
            
            #pointInside = [p for p in pointInCurve if viewArea.Contains(p) == Rhino.Geometry.PointContainment.Inside]
            pointInside = []
            for p in pointInCurve:
                pointPos = viewArea.Contains(p)
                if pointPos == Rhino.Geometry.PointContainment.Inside:
                    vDir = Point3d.Subtract(p,y)
                    vDir.Unitize()
                    line = Line(y,vDir,length)
                
                    iSect = Rhino.Geometry.Intersect.Intersection.CurveCurve(viewArea.ToNurbsCurve(),line.ToNurbsCurve(),0,0)
                    
                    for sect in iSect:
                        pointInside.append((p,sect.pointA))
                        #TODO: sort pointInside based on projection which has smallest placement in curve
                        #HINT: possibly using Rhino.Geometry.Curve.ClosestPoint
                    
            #Rhino.Geometry.Curve.ClosestPoint(
            #pointToConsiderate.extend(pointInside)
            
            #projection of point inside curve
            #for p in pointInside:
                #vDir = Point3d.Subtract(p,y)
                #vDir.Unitize()
                #line = Line(y,vDir,length)
                
                #iSect = Rhino.Geometry.Intersect.Intersection.CurveCurve(viewArea.ToNurbsCurve(),line.ToNurbsCurve(),0,0)
                #for sect in iSect:
                   # pointToConsiderate.append(sect.PointA)
                
            
            
            
            for p in pointToConsiderate:
                print p
        
        
        
        #for wall in wallList:
            #print wall.Geometry.GetType()
            #Rhino.DocObjects.CurveObject.Geometry
            #iSect = Rhino.Geometry.Intersect.Intersection.CurveCurve(wall.Geometry,mLine2.ToNurbsCurve(),0,0)
            #for inte in iSect:
                
        
        
            #vect = vect/vect.Length
        #Rhino.Geometry.Intersect.IntersectionEvent.PointA
        
        #Rhino.Geometry.Intersect.CurveIntersections.Item
        #Rhino.Geometry.Line(
        #print iSect
        print "ccccccccccccccccc"
        
        #view = sc.doc.Views.ActiveView.ActiveViewport      
        #objectList = rh.RhinoDoc.ActiveDoc.Objects.FindByCrossingWindowRegion(view,pl,True,rh.DocObjects.ObjectType.Curve)
        #Vector3d.Rotate(
        #print objectList
        #for oi in objectList:
            #rg.Intersect.Intersection.CurveCurve(
            #rs.CurveCurveIntersection
            #print oi.Id
            #rs.CurveCurveIntersection(
            #iter = []
            #iter = rs.CurveCurveIntersection(oi.CurveGeometry,x,0)
            #p = []
            #iter(p)
            #if not iter:
                #continue
            #print iter
            #print p
            #for aa in iter:
                #print aa
            #print "bbbbbbbbbbb"
        # return outputs if you have them; here I try it for you:
        return None
# ---------- end python_2 ----------
