# Grasshopper definition unit-door.ghx (Grasshopper 1.0.7)

rec = Rectangle({Plane=PlaneXY(3.736260529, 15.83201004, 0), Size=Domain2(u=-0.8135683647..0.8135683647, v=-0.7705749146..0.7705749146)})
python = GhPythonScript(x=rec)  # -> a
# ---------- python: Python ----------
from ghpythonlib.componentbase import executingcomponent as component
import Grasshopper, GhPython
import System
import Rhino as rh
import rhinoscriptsyntax as rs
import scriptcontext as sc
import sys
from Rhino.Geometry import Point3d,Vector3d
import Rhino.DocObjects
import math

cFPath = ghenv.Component.OnPingDocument().FilePath
cpath = cFPath[0:cFPath.rfind('\\')+1]
my_path = cpath+'..\source'
if not my_path in sys.path:
    sys.path.append(my_path)

import Door

class MyComponent(component):
    
    def RunScript(self,x):
        """Provides a scripting component.
            Inputs:
                x: The x script variable
                y: The y script variable
            Output:
                a: The a output variable"""
        
        __author__ = "remote"
        __version__ = "2020.12.18"
        
        import rhinoscriptsyntax as rs
        rectArea = rs.coercecurve(x)
        rc,pl = rectArea.TryGetPolyline()
        #print rc
        #print pl
        view = sc.doc.Views.ActiveView.ActiveViewport
        objectList = rh.RhinoDoc.ActiveDoc.Objects.FindByCrossingWindowRegion(view,pl,True,rh.DocObjects.ObjectType.AnyObject)
        doorObject = []
        doorGroup = []
        
        doorPanelGroup = []
        doorPanelObject = []
        doorFrameGroup = []
        doorFrameObject = []
        #rh.Geometry.BoundingBox.Union.
        for oo in objectList:
            #print oo.Id
            #print rs.GetUserText(oo,"Type")
            if rs.GetUserText(oo,"Type") == "Door":
                groupList = oo.GetGroupList()
                print rs.GetUserText(oo,"Part")
                part = rs.GetUserText(oo,"Part")
                
                if part == "Door":
                    doorPanelObject.append(oo)
                    for group in groupList:
                        doorPanelGroup.append(group)
                else:
                    found = False
                    index = -1
                    for group in groupList:
                        for (idx,existGroup) in enumerate(doorFrameGroup):
                            for singleGroup in existGroup:
                                if group == singleGroup:
                                    found = True
                                    index = idx
                                    break
                    if not found:
                        doorFrameGroup.append(groupList)
                        doorFrameObject.append([oo])
                    else:
                        doorFrameObject[index].append(oo)
            
        tesObj = None
        for oi in doorPanelObject:
            print oi.GetType()
            print oi.Id
            tesObj = oi
        
        print "frame"
        for ou in doorFrameObject:
            for kk in ou:
               print kk.Id
        pClone = None
        #rh.Geometry.InstanceReferenceGeometry.GetBoundingBox(
        #rh.Geometry.BoundingBox.Center
        for (doorGroup,panelObj) in zip(doorPanelGroup,doorPanelObject):
            index = -1
            for (idx,frameGroups) in enumerate(doorFrameGroup):
                for group in frameGroups:
                    if doorGroup == group:
                        index = idx
                        break
                if index != -1:
                    break
            if index != -1:
                print panelObj.GetType()
                pClone = panelObj.DuplicateGeometry()
                print pClone.GetType()
                doorObject.append(Door.Door(panelObj,rh.Geometry.BoundingBox.Union(doorFrameObject[index][0].Geometry.GetBoundingBox(True),doorFrameObject[index][1].Geometry.GetBoundingBox(True)),1))
        # return outputs if you have them; here I try it for you:
        #rs.AddPoints(
        pClone.Translate(1.0,0.0,0.0)
        #listClone = []
        #listClone.append(pClone)
        listCenter = []
        #rh.DocObjects.InstanceObject.InstanceDefinition.Index
        #rh.Geometry.InstanceReferenceGeometry.Xform
        corona = tesObj.Geometry.GetBoundingBox(True).GetCorners()
        print "ago"
        print corona
        print "bego"
        print tesObj.Geometry.GetBoundingBox(True).Center
        #tesObj.Geometry.Translate(1.0,0.0,0.0)
        centerRotation = tesObj.Geometry.GetBoundingBox(True).GetCorners()[3]
        print centerRotation
        centerRotation.X += 0.01
        print "lembu"
        print centerRotation
        tesObj.Geometry.Rotate(math.radians(90),Vector3d.ZAxis,centerRotation) 
        goo = tesObj.CommitChanges()
        print goo
        print tesObj.Geometry.GetBoundingBox(True).Center
        print tesObj.Index
        print tesObj.Geometry.Xform
        gai = rh.RhinoDoc.ActiveDoc.Objects.AddInstanceObject(tesObj.InstanceDefinition.Index,tesObj.Geometry.Xform)
        print gai
        #rh.RhinoDoc.ActiveDoc.Objects.AddPoint(pClone.GetBoundingBox(True).Center)
        #rh.RhinoDoc.ActiveDoc.Objects.AddRhinoObject(
        #rs.AddPoint(pClone.GetBoundingBox(True).Center)
        #return pClone.GetBoundingBox(True).Center
        return None#listClone#.GetBoundingBox(True).Center
# ---------- end python ----------
geo = Geometry(python)
